# Dynamo custom node ActiveDocument.dyf (Dynamo 2.7.0.9206)
# category: DynFreeCAD.Document
# Get active FreeCAD document

Run = Input(Run: bool = true)
python_script = Python(IN[0]=Run)  # CPython3
# ---------- python_script.python (8 lines) ----------
# import
import clr
import FreeCAD

ad = FreeCAD.ActiveDocument.Name


OUT = ad
# ----------------------------------------
activeDocumentName = Output(python_script)
