# Dynamo custom node CloseDocument.dyf (Dynamo 2.7.0.9206)
# category: DynFreeCAD.Document
# Close an open FreeCAD document

DocumentName = Input(DocumentName: string)
python_script = Python(IN[0]=DocumentName)  # CPython3
# ---------- python_script.python (10 lines) ----------
# import
import clr
import FreeCAD

docName = IN[0]

FreeCAD.closeDocument(docName)


OUT = True
# ----------------------------------------
Success = Output(python_script)
