# Dynamo custom node ActiveDocument.dyf (Dynamo 2.8.0.2327)
# category: DynFreeCAD.Document
# Get active FreeCAD document

run = Input(run: bool = true)
python_script = Python(IN[0]=run)  # CPython3
# ---------- python_script.python (5 lines) ----------
import FreeCAD

ad = FreeCAD.ActiveDocument

OUT = ad
# ----------------------------------------
FreeCADDocument = Output(python_script)
