# Dynamo custom node CloseDocument.dyf (Dynamo 2.8.0.2327)
# category: DynFreeCAD.Document
# Close an open FreeCAD document

FreeCADDocument = Input(FreeCADDocument: System.Object)
python_script = Python(IN[0]=FreeCADDocument)  # CPython3
# ---------- python_script.python (10 lines) ----------
# import
import clr
import FreeCAD

docName = IN[0].Name

FreeCAD.closeDocument(docName)


OUT = True
# ----------------------------------------
success = Output(python_script)
