# Dynamo custom node NewDocument.dyf (Dynamo 2.8.0.2327)
# category: DynFreeCAD.Document
# Create new document in FreeCAD

name = Input(name: string = None)
run = Input(run: bool = true)
python_script = Python(IN[0]=name, IN[1]=run)  # CPython3
# ---------- python_script.python (12 lines) ----------
# import
import clr
import FreeCAD

docName = IN[0]

if docName==None:
	doc = FreeCAD.newDocument()
else:
	doc = FreeCAD.newDocument(docName)

OUT = doc
# ----------------------------------------
FreeCADDocument = Output(python_script)
