# Dynamo custom node ActiveDocument.dyf (Dynamo 2.8.0.2471)
# category: DynFreeCAD.Document
# Get active FreeCAD document

reload = Input(reload: bool = true)
FreeCADModule = Input(FreeCADModule: var[]..[])
python_script = Python(IN[0]=reload, IN[1]=FreeCADModule)  # CPython3
# ---------- python_script.python (5 lines) ----------
FreeCAD = IN[1]

ad = FreeCAD.ActiveDocument

OUT = ad
# ----------------------------------------
FreeCADDocument = Output(python_script)
