# Dynamo custom node Arch.Create.MakeProject.dyf "MakeProject" (Dynamo 2.10.0.3071)
# category: DynFreeCAD.Arch.Create
# Create a FreeCAD Arch Project entity.

FreeCADDocument = Input(FreeCADDocument: System.Object)
FreeCADSite = Input(FreeCADSite: System.Object = null)
python_script = Python(IN[0]=FreeCADDocument, IN[1]=FreeCADSite)  # CPython3
# ---------- python_script.python (32 lines) ----------
import FreeCAD
import Arch
import Draft

doc = IN[0]
site = IN[1]
try:
    errorReport = None

    # set active document
    if FreeCAD.ActiveDocument != doc:
        FreeCAD.setActiveDocument(doc.Name)
    
    # check if site is a none
    if type(site) is None:
        obj = Arch.makeProject()
    else:
        obj = Arch.makeProject(site)
        
    # Autogroup, I'm nut sure if I need it
    #Draft.autogroup(obj)

except:
    import traceback
    errorReport = traceback.format_exc()

if errorReport == None:
    # This will run if no error. 
    OUT = [doc,obj]
    
else:
    OUT = [errorReport,type(site)]
# ----------------------------------------
code_block = CodeBlock(a=python_script) { a[0]; a[1]; }
FreeCADDocument_2 = Output(code_block.out0)  # "FreeCADDocument"
FreeCADArchProject = Output(code_block.out1)
