# Dynamo custom node Arch.Create.MakeSite.dyf "MakeSite" (Dynamo 2.10.0.3071)
# category: DynFreeCAD.Arch.Create
# Create a FreeCAD Arch Site object

FreeCADDocument = Input(FreeCADDocument: System.Object)
FreeCADObject = Input(FreeCADObject: System.Object = null)
FreeCADTerrain = Input(FreeCADTerrain: System.Object = null)
python_script = Python(IN[0]=FreeCADDocument, IN[1]=FreeCADObject, IN[2]=FreeCADTerrain)  # CPython3
# ---------- python_script.python (36 lines) ----------
import FreeCAD
import Arch
import Draft

doc = IN[0]
objects = IN[1]
terrain = IN[2]
try:
    errorReport = None

    # set active document
    if FreeCAD.ActiveDocument != doc:
        FreeCAD.setActiveDocument(doc.Name)
    
    # check if site is a none
    if type(terrain) is None and type(objects) is None:
        site = Arch.makeSite()
    elif type(terrain) is not None and type(objects) is None:
        site = Arch.makeSite([],terrain)
    else:
        site = Arch.makeSite(objects,terrain)
    
        
    # Autogroup, I'm not sure if I need it
    #Draft.autogroup(site)

except:
    import traceback
    errorReport = traceback.format_exc()

if errorReport == None:
    # This will run if no error. 
    OUT = [doc,site]
    
else:
    OUT = [errorReport, 0]
# ----------------------------------------
code_block = CodeBlock(a=python_script) { a[0]; a[1]; }
FreeCADDocument_2 = Output(code_block.out0)  # "FreeCADDocument"
FreeCADSite = Output(code_block.out1)
