# Dynamo custom node CloseAllDocuments.dyf (Dynamo 2.8.0.2327)
# category: DynFreeCAD.Document
# Close all open FreeCAD documents

run = Input(run: bool = true)
python_script = Python(IN[0]=run)  # CPython3
# ---------- python_script.python (10 lines) ----------
import FreeCAD

list_docs_dict = FreeCAD.listDocuments()
list_docs = []


for key in list_docs_dict:
	FreeCAD.closeDocument(key)

OUT = True
# ----------------------------------------
success = Output(python_script)
