# Dynamo custom node Document.Action.SaveAs.dyf "SaveAs" (Dynamo 2.10.0.3071)
# category: DynFreeCAD.Document
# Save FreeCAD document to a path

path = Input(path: string)
FreeCADDocument = Input(FreeCADDocument: System.Object)
python_script = Python(IN[0]=path, IN[1]=FreeCADDocument)  # CPython3
# ---------- python_script.python (19 lines) ----------
import FreeCAD

docPath = IN[0]
doc = IN[1]

try:
    errorReport = None

    doc.saveAs(docPath)

except:
    import traceback
    errorReport = traceback.format_exc()

if errorReport == None:
    OUT = doc

else:
    OUT = errorReport
# ----------------------------------------
FreeCADDocument_2 = Output(python_script)  # "FreeCADDocument"
