# Dynamo custom node Document.ActiveDocument.dyf "ActiveDocument" (Dynamo 2.9.0.2476)
# category: DynFreeCAD.Document
# Get active FreeCAD document

reload = Input(reload: bool = true)
python_script = Python(IN[0]=reload)  # CPython3
# ---------- python_script.python (5 lines) ----------
import FreeCAD

ad = FreeCAD.ActiveDocument

OUT = ad
# ----------------------------------------
FreeCADDocument = Output(python_script)
