# Dynamo custom node Document.Document.CloseAllDocuments.dyf "CloseAllDocuments" (Dynamo 2.9.0.2536)
# category: DynFreeCAD.Document.Manage
# Close all open FreeCAD documents

run = Input(run: bool = false)
python_script = Python(IN[0]=run)  # CPython3
# ---------- python_script.python (11 lines) ----------
import FreeCAD

list_docs_dict = FreeCAD.listDocuments()
list_docs = []

if IN[0] == True:
    for key in list_docs_dict:
    	FreeCAD.closeDocument(key)


OUT = IN[0]
# ----------------------------------------
success = Output(python_script)
