# Dynamo custom node Document.Document.NewDocument.dyf "NewDocument" (Dynamo 2.9.0.2536)
# category: DynFreeCAD.Document.Document
# Create new document in FreeCAD

FreeCADBinPath = Input(FreeCADBinPath: string)
name = Input(name: string = None)
python_script = Python(IN[0]=FreeCADBinPath, IN[1]=name)  # CPython3
# ---------- python_script.python (17 lines) ----------
import sys
freecad_bin_path=IN[0]
sys.path.append(freecad_bin_path)

import FreeCAD

docName = IN[1]

if docName==None:
	doc = FreeCAD.newDocument()
else:
	doc = FreeCAD.newDocument(docName)

fc_version = FreeCAD.Version()
sys_path = sys.path

OUT = [doc, fc_version, sys_path]
# ----------------------------------------
code_block = CodeBlock(a=python_script) { a[0]; a[1]; a[2]; }
uniqueItems = List.UniqueItems(list=code_block.out2)
sysPaths = Output(uniqueItems)
FreeCADDocument = Output(code_block.out0)
FreeCADversion = Output(code_block.out1)
