# Dynamo custom node Document.Document.OpenDocument.dyf "OpenDocument" (Dynamo 2.9.0.2536)
# category: DynFreeCAD.Document.Document
# Open a document in FreeCAD

FreeCADBinPath = Input(FreeCADBinPath: string)
filePath = Input(filePath: string)
python_script = Python(IN[0]=FreeCADBinPath, IN[1]=filePath)  # CPython3
# ---------- python_script.python (17 lines) ----------
import sys
freecad_bin_path=IN[0]
sys.path.append(freecad_bin_path)

import FreeCAD

docPath = IN[1]

doc = FreeCAD.openDocument(docPath)

output = []

fc_version = FreeCAD.Version()
sys_path = sys.path

  
OUT = [doc, fc_version, sys_path]
# ----------------------------------------
code_block = CodeBlock(a=python_script) { a[0]; a[1]; a[2]; }
FreeCADDocument = Output(code_block.out0)
uniqueItems = List.UniqueItems(list=code_block.out2)
sysPaths = Output(uniqueItems)
FreeCADversion = Output(code_block.out1)
