# Dynamo custom node Document.Document.SaveAs.dyf "SaveAs" (Dynamo 2.9.0.2536)
# category: DynFreeCAD.Document.Document
# Save FreeCAD document to a path

path = Input(path: string)
FreeCADDocument = Input(FreeCADDocument: System.Object)
python_script = Python(IN[0]=path, IN[1]=FreeCADDocument)  # CPython3
# ---------- python_script.python (8 lines) ----------
import FreeCAD

docPath = IN[0]
doc = IN[1]

doc.saveAs(docPath)

OUT = docSave
# ----------------------------------------
FreeCADDocument_2 = Output(python_script)  # "FreeCADDocument"
