# Dynamo custom node Document.ListDocuments.dyf "ListDocuments" (Dynamo 2.9.0.2476)
# category: DynFreeCAD.Document
# List all open FreeCAD documents

reload = Input(reload: bool = true)
python_script = Python(IN[0]=reload)  # CPython3
# ---------- python_script.python (5 lines) ----------
import FreeCAD

list_docs_dict = FreeCAD.listDocuments()

OUT = list_docs_dict
# ----------------------------------------
FreeCADDocuments = Output(python_script)
