# Dynamo custom node Document.Manage.ActiveDocument.dyf "ActiveDocument" (Dynamo 2.9.0.2536)
# category: DynFreeCAD.Document.Manage
# Get active FreeCAD document

reload = Input(reload: bool = true)
python_script = Python(IN[0]=reload)  # CPython3
# ---------- python_script.python (5 lines) ----------
import FreeCAD

ad = FreeCAD.ActiveDocument

OUT = ad
# ----------------------------------------
FreeCADDocument = Output(python_script)
