# Dynamo custom node Document.Manage.CloseDocument.dyf "CloseDocument" (Dynamo 2.9.0.2536)
# category: DynFreeCAD.Document.Manage
# Close an open FreeCAD document

FreeCADDocument = Input(FreeCADDocument: System.Object)
python_script = Python(IN[0]=FreeCADDocument)  # CPython3
# ---------- python_script.python (10 lines) ----------
# import
import clr
import FreeCAD

docName = IN[0].Name

FreeCAD.closeDocument(docName)


OUT = True
# ----------------------------------------
success = Output(python_script)
