# Dynamo custom node Document.Manage.Recompute.dyf "Recompute" (Dynamo 2.9.0.2536)
# category: DynFreeCAD.Document.Manage
# Recompute a FreeCAD Document

FreeCADDocument = Input(FreeCADDocument: System.Object)
python_script = Python(IN[0]=FreeCADDocument)  # CPython3
# ---------- python_script.python (7 lines) ----------
import FreeCAD

doc = IN[0]

doc.recompute()

OUT = doc
# ----------------------------------------
FreeCADDocument_2 = Output(python_script)  # "FreeCADDocument: System.Object"
