# Dynamo custom node Document.Manage.SetActiveDocument.dyf "SetActiveDocument" (Dynamo 2.9.0.2536)
# category: DynFreeCAD.Document.Manage
# Set active FreeCAD document

FreeCADDocument = Input(FreeCADDocument: System.Object)
python_script = Python(IN[0]=FreeCADDocument)  # CPython3
# ---------- python_script.python (9 lines) ----------
import FreeCAD

doc = IN[0]

FreeCAD.setActiveDocument(doc.Name)

ad = FreeCAD.ActiveDocument

OUT = ad
# ----------------------------------------
FreeCADDocument_2 = Output(python_script)  # "FreeCADDocument"
