# Dynamo custom node Document.Objects.GetObjectByName.dyf "GetObjectByName" (Dynamo 2.9.0.2476)
# category: DynFreeCAD.Document.Objects
# Get object in a FreeCAD document by name

FreeCADDocument = Input(FreeCADDocument: System.Object)
objectName = Input(objectName: string)
python_script = Python(IN[0]=FreeCADDocument, IN[1]=objectName)  # CPython3
# ---------- python_script.python (8 lines) ----------
import FreeCAD

doc = IN[0]
obj_name = IN[1]

obj = doc.getObject(obj_name)

OUT = obj
# ----------------------------------------
FreeCADObject = Output(python_script)  # "FreeCADObject: System.Object"
