# Dynamo custom node Document.Objects.ListAllObjects.dyf "ListAllObjects" (Dynamo 2.9.0.2476)
# category: DynFreeCAD.Document.Objects
# List all objects from a FreeCAD document

FreeCADDocument = Input(FreeCADDocument: System.Object)
python_script = Python(IN[0]=FreeCADDocument)  # CPython3
# ---------- python_script.python (14 lines) ----------
import FreeCAD

document = IN[0]

names = []
objs = []
labels = []

for obj in document.Objects:
    names.append(obj.Name)
    objs.append(obj)
    labels.append(obj.Label)
    
OUT = [names,objs,labels]
# ----------------------------------------
code_block = CodeBlock(a=python_script) { a[0]; a[1]; a[2]; }
names = Output(code_block.out0)  # "names:List"
FreeCADObjects = Output(code_block.out1)  # "FreeCADObjects:List"
labels = Output(code_block.out2)  # "labels:List"
