# Dynamo custom node Document.Properties.Name.dyf "Name" (Dynamo 2.9.0.2536)
# category: DynFreeCAD.Document.Properties
# Returns the name of a FreeCAD document

FreeCADDocument = Input(FreeCADDocument: System.Object)
python_script = Python(IN[0]=FreeCADDocument)  # CPython3
# ---------- python_script.python (5 lines) ----------
import FreeCAD

doc = IN[0]

OUT= doc.Name
# ----------------------------------------
string = Output(python_script)
