# Dynamo custom node Document.Query.FileName.dyf "FileName" (Dynamo 2.9.0.2536)
# category: DynFreeCAD.Document.Query
# Full path including filename of a FreeCAD document

FreeCADDocument = Input(FreeCADDocument: System.Object)
python_script = Python(IN[0]=FreeCADDocument)  # CPython3
# ---------- python_script.python (6 lines) ----------
import FreeCAD

doc = IN[0]
fn = doc.FileName

OUT = fn
# ----------------------------------------
filePath = Output(python_script)  # "filePath: string"
