# Dynamo custom node Document.Query.ListDocuments.dyf "ListDocuments" (Dynamo 2.9.0.2536)
# category: DynFreeCAD.Document.Query
# List all open FreeCAD documents

reload = Input(reload: bool = true)
python_script = Python(IN[0]=reload)  # CPython3
# ---------- python_script.python (5 lines) ----------
import FreeCAD

list_docs_dict = FreeCAD.listDocuments()

OUT = list_docs_dict
# ----------------------------------------
FreeCADDocuments = Output(python_script)
