# Dynamo custom node FindAllObjects.dyf (Dynamo 2.8.0.2327)
# category: DynFreeCAD.Document
# find FreeCAD objects in a document by specified type, name or label. All parameters are optional.

FreeCADDocument = Input(FreeCADDocument: System.Object)
python_script = Python(IN[0]=FreeCADDocument)  # CPython3
# ---------- python_script.python (7 lines) ----------
import FreeCAD

doc = IN[0]

objs = doc.findObjects()

OUT = objs
# ----------------------------------------
FreeCADObjects = Output(python_script)  # "FreeCADObjects:List"
