# Dynamo custom node Group.Create.Create.dyf "Create" (Dynamo 2.9.0.2476)
# category: DynFreeCAD.Group.Create
# Create a new empty FreeCAD Group

FreeCADDocument = Input(FreeCADDocument: System.Object)
python_script = Python(IN[0]=FreeCADDocument)  # CPython3
# ---------- python_script.python (8 lines) ----------
doc = IN[0]

import FreeCAD

doc.addObject("App::DocumentObjectGroup","Group")
obj = doc.ActiveObject

OUT = [doc, obj]
# ----------------------------------------
code_block = CodeBlock(a=python_script) { a[0]; a[1]; }
FreeCADGroup = Output(code_block.out1)
FreeCADDocument_2 = Output(code_block.out0)  # "FreeCADDocument"
