# Dynamo custom node Group.Query.Objects.dyf "Objects" (Dynamo 2.8.0.2327)
# category: DynFreeCAD.Group.Query
# List objects in a FreeCAD group

FreeCADGroup = Input(FreeCADGroup: System.Object)
python_script = Python(IN[0]=FreeCADGroup)  # CPython3
# ---------- python_script.python (6 lines) ----------
import FreeCAD

obj = IN[0]

    
OUT = obj.Group
# ----------------------------------------
FreeCADObjects = Output(python_script)  # "FreeCADObjects:List"
