# Dynamo custom node Initialize.dyf (Dynamo 2.8.0.2471)
# category: DynFreeCAD.App
# Initialize FreeCAD api and FreeCAD version info

code_block = CodeBlock { "bin"; "lib"; "Mod"; }
list_create = List.Create(item0=code_block.out0, item1=code_block.out1, item2=code_block.out2)
FreeCADPath = Input(FreeCADPath: string)
combinePath = FileSystem.CombinePath(path0=FreeCADPath, lacing=CrossProduct)  # unwired: path1
map = List.Map(list=list_create, f_x=combinePath)
python_script = Python(IN[0]=map)  # CPython3
# ---------- python_script.python (21 lines) ----------
import sys

freecad_bin_path=IN[0][0]
freecad_lib_path=IN[0][1]
freecad_mod_path=IN[0][2]

sys.path.insert(0,freecad_bin_path)
sys.path.insert(0,freecad_lib_path)
sys.path.insert(0,freecad_mod_path)

import FreeCAD

output = []

fc_version = FreeCAD.Version()
sys_path = sys.path

for outer in [fc_version, sys_path]:
    output.append(outer)    

OUT = output
# ----------------------------------------
code_block_2 = CodeBlock(a=python_script) { a[0]; a[1]; }
FreeCADversion = Output(code_block_2.out0)
uniqueItems = List.UniqueItems(list=code_block_2.out1)
sysPaths = Output(uniqueItems)
