# Dynamo custom node InitializeWithGui.dyf (Dynamo 2.9.0.2476)
# category: DynFreeCAD.App
# ⚠ WIP! NOT WORKING YET! ⚠
# Start FreeCAD with Gui

FreeCADbinPath = Input(FreeCADbinPath: string)
python_script = Python(IN[0]=FreeCADbinPath)  # CPython3
# ---------- python_script.python (17 lines) ----------
import sys

freecad_bin_path=IN[0]

sys.path.append(freecad_bin_path)

import FreeCADGui, FreeCAD

output = []

fc_version = FreeCAD.Version()
sys_path = sys.path

for outer in [fc_version, sys_path]:
    output.append(outer)    

OUT = output
# ----------------------------------------
code_block = CodeBlock(a=python_script) { a[0]; a[1]; }
FreeCADversion = Output(code_block.out0)
uniqueItems = List.UniqueItems(list=code_block.out1)
sysPaths = Output(uniqueItems)
