# Dynamo custom node ListDocuments.dyf (Dynamo 2.8.0.2471)
# category: DynFreeCAD.Document
# List all open FreeCAD documents

reload = Input(reload: bool = true)
FreeCADModule = Input(FreeCADModule: var[]..[])
python_script = Python(IN[0]=reload, IN[1]=FreeCADModule)  # CPython3
# ---------- python_script.python (5 lines) ----------
FreeCAD = IN[1]

list_docs_dict = FreeCAD.listDocuments()

OUT = list_docs_dict
# ----------------------------------------
FreeCADDocuments = Output(python_script)
