# Dynamo custom node Mesh.Create.Cube.dyf "Cube" (Dynamo 2.9.0.2591)
# category: DynFreeCAD.Mesh.Create
# Create a FreeCAD mesh cube

FreeCADDocument = Input(FreeCADDocument: System.Object)
length = Input(length: double = 10)
width = Input(width: double = 10)
height = Input(height: double = 10)
name = Input(name: string = "")
python_script = Python(IN[0]=FreeCADDocument, IN[1]=length, IN[2]=width, IN[3]=height, IN[4]=name)  # CPython3
# ---------- python_script.python (15 lines) ----------
import FreeCAD
import Mesh

doc = IN[0]
length = IN[1]
width = IN[2]
height = IN[3]
name = IN[4]

mcube = doc.addObject("Mesh::Cube", name)
mcube.Length = length
mcube.Width = width
mcube.Height = height

OUT = [doc,mcube]
# ----------------------------------------
code_block = CodeBlock(a=python_script) { a[0]; a[1]; }
FreeCADDocument_2 = Output(code_block.out0)  # "FreeCADDocument: System.Object"
FreeCADMeshCube = Output(code_block.out1)  # "FreeCADMeshCube: System.Object"
