# Dynamo custom node Mesh.Create.Insert.dyf "Insert" (Dynamo 2.9.0.2476)
# category: DynFreeCAD.Mesh.Create
# Import a Mesh to a FreeCAD document

FreeCADDocument = Input(FreeCADDocument: System.Object)
importPath = Input(importPath: string)
python_script = Python(IN[0]=FreeCADDocument, IN[1]=importPath)  # CPython3
# ---------- python_script.python (15 lines) ----------
import FreeCAD
import Mesh

doc = IN[0]
insert_path = IN[1]

if doc is FreeCAD.ActiveDocument:
    Mesh.insert(insert_path)
else: 
    olddoc = FreeCAD.ActiveDocument
    FreeCAD.setActiveDocument(doc.Name)
    Mesh.insert(insert_path)
    FreeCAD.setActiveDocument(olddoc.Name)

OUT = doc
# ----------------------------------------
FreeCADDocument_2 = Output(python_script)  # "FreeCADDocument"
