# Dynamo custom node Object.Get.Label.dyf "Label" (Dynamo 2.8.0.2327)
# category: DynFreeCAD.Object.Get
# The label of a FreeCAD object

FreeCADObject = Input(FreeCADObject: System.Object)
python_script = Python(IN[0]=FreeCADObject)  # CPython3
# ---------- python_script.python (5 lines) ----------
import FreeCAD

obj = IN[0]

OUT= obj.Label
# ----------------------------------------
string = Output(python_script)
