# Dynamo custom node Object.Query.Document.dyf "Document" (Dynamo 2.9.0.2536)
# category: DynFreeCAD.Object.Query
# Get the FreeCAD document of an object

FreeCADObject = Input(FreeCADObject: System.Object)
python_script = Python(IN[0]=FreeCADObject)  # CPython3
# ---------- python_script.python (5 lines) ----------
import FreeCAD

obj = IN[0]

OUT = obj.Document
# ----------------------------------------
FreeCADDocument = Output(python_script)  # "FreeCADDocument: System.Object"
