# Dynamo custom node Object.Query.GetPropertyValueByName.dyf "GetPropertyValueByName" (Dynamo 2.9.0.2476)
# category: DynFreeCAD.Object.Query
# Get a value of a FreeCAD object's property

FreeCADObject = Input(FreeCADObject: System.Object)
propertyName = Input(propertyName: string)
python_script = Python(IN[0]=FreeCADObject, IN[1]=propertyName)  # CPython3
# ---------- python_script.python (8 lines) ----------
import FreeCAD

obj = IN[0]
propname = IN[1]

val = getattr(obj,propname)

OUT = val
# ----------------------------------------
value = Output(python_script)
