# Dynamo custom node Object.Query.Placement.dyf "Placement" (Dynamo 2.9.0.2591)
# category: DynFreeCAD.Object.Query
# Returns the placement of a FreeCAD object

FreeCADObject = Input(FreeCADObject: System.Object)
python_script = Python(IN[0]=FreeCADObject)  # CPython3
# ---------- python_script.python (7 lines) ----------
import FreeCAD

obj = IN[0]
plac = obj.Placement 


OUT= [plac, plac.Base, plac.Rotation, plac.Matrix]
# ----------------------------------------
code_block = CodeBlock(a=python_script) { a[0]; a[1]; a[2]; a[3]; }
placement = Output(code_block.out0)
base = Output(code_block.out1)
rotation = Output(code_block.out2)
matrix = Output(code_block.out3)
