# Dynamo custom node Object.Query.Properties.dyf "Properties" (Dynamo 2.8.0.2327)
# category: DynFreeCAD.Object.Query
# Properties of a FreeCAD object

FreeCADObject = Input(FreeCADObject: System.Object)
python_script = Python(IN[0]=FreeCADObject)  # CPython3
# ---------- python_script.python (13 lines) ----------
import FreeCAD

obj = IN[0]

proplist = {}

op = obj.PropertiesList

for p in op:
    pr = obj.getPropertyByName(p)
    proplist[p] = pr
    
OUT = proplist
# ----------------------------------------
dictionary = Output(python_script)  # "dictionary:Dictionary"
