# Dynamo custom node Object.Set.AddToGroup.dyf "AddToGroup" (Dynamo 2.9.0.2476)
# category: DynFreeCAD.Object.Set
# Add a FreeCAD object to a Group

FreeCADGroup = Input(FreeCADGroup: System.Object)
FreeCADObject = Input(FreeCADObject: System.Object)
python_script = Python(IN[0]=FreeCADGroup, IN[1]=FreeCADObject)  # CPython3
# ---------- python_script.python (9 lines) ----------
parent = IN[0]
child = IN[1]

import FreeCAD

child.adjustRelativeLinks(parent)
parent.addObject(child)

OUT = parent
# ----------------------------------------
FreeCADGroup_2 = Output(python_script)  # "FreeCADGroup:System.Object"
