# Dynamo custom node Object.Set.Move.dyf "Move" (Dynamo 2.9.0.2591)
# category: DynFreeCAD.Object.Set
# Move a FreeCAD object by 3 coordinates

FreeCADObject = Input(FreeCADObject: System.Object)
x = Input(x: double)
y = Input(y: double)
z = Input(z: double)
python_script = Python(IN[0]=FreeCADObject, IN[1]=x, IN[2]=y, IN[3]=z)  # CPython3
# ---------- python_script.python (10 lines) ----------
import FreeCAD

obj = IN[0]
x = IN[1]
y = IN[2]
z = IN[3]

obj.Placement.move(FreeCAD.Vector(x,y,z))

OUT = obj
# ----------------------------------------
FreeCADObject_2 = Output(python_script)  # "FreeCADObject"
