# Dynamo custom node Object.Set.MoveByVector.dyf "MoveByVector" (Dynamo 2.9.0.2591)
# category: DynFreeCAD.Object.Set
# Move a FreeCAD object by a Dynamo vector

FreeCADObject = Input(FreeCADObject: System.Object)
vector = Input(vector: Autodesk.DesignScript.Geometry.Vector)
python_script = Python(IN[0]=FreeCADObject, IN[1]=vector)  # CPython3
# ---------- python_script.python (9 lines) ----------
import FreeCAD

obj = IN[0]
vec = IN[1]


obj.Placement.move(FreeCAD.Vector(vec.X, vec.Y, vec.Z))

OUT = obj
# ----------------------------------------
FreeCADObject_2 = Output(python_script)  # "FreeCADObject"
