# Dynamo custom node Object.Set.RemoveObject.dyf "RemoveObject" (Dynamo 2.9.0.2536)
# category: DynFreeCAD.Object.Set
# Delete an object from it's document

FreeCADObject = Input(FreeCADObject: System.Object)
python_script = Python(IN[0]=FreeCADObject)  # CPython3
# ---------- python_script.python (8 lines) ----------
import FreeCAD

obj = IN[0]
doc = obj.Document

doc.removeObject(obj.Name)

OUT = doc
# ----------------------------------------
FreeCADDocument = Output(python_script)  # "FreeCADDocument: System.Object"
