# Dynamo custom node Object.Set.Rotate.dyf "Rotate" (Dynamo 2.9.0.2591)
# category: DynFreeCAD.Object.Set
# Rotate a FreeCAD object by center, axis and degree

FreeCADObject = Input(FreeCADObject: System.Object)
centerX = Input(centerX: double = 0)
centerY = Input(centerY: double = 0)
centerZ = Input(centerZ: double = 0)
axisX = Input(axisX: double = 0)
axisY = Input(axisY: double = 0)
axisZ = Input(axisZ: double = 1)
degree = Input(degree: double)
python_script = Python(IN[0]=FreeCADObject, IN[1]=centerX, IN[2]=centerY, IN[3]=centerZ, IN[4]=axisX, IN[5]=axisY, IN[6]=axisZ, IN[7]=degree)  # CPython3
# ---------- python_script.python (14 lines) ----------
import FreeCAD

obj = IN[0]
cx = IN[1]
cy = IN[2]
cz = IN[3]
ax = IN[4]
ay = IN[5]
az = IN[6]
deg = IN[7]

obj.Placement.rotate((cx,cy,cz), FreeCAD.Vector(ax,ay,az), deg)

OUT = obj
# ----------------------------------------
FreeCADObject_2 = Output(python_script)  # "FreeCADObject"
