# Dynamo custom node Object.Set.RotateByVectorAndPoint.dyf "RotateByVectorAndPoint" (Dynamo 2.9.0.2591)
# category: DynFreeCAD.Object.Set
# Rotate a FreeCAD object by a Dynamo vector and a dynamo Point

FreeCADObject = Input(FreeCADObject: System.Object)
vector = Input(vector: Autodesk.DesignScript.Geometry.Vector)
point = Input(point: Autodesk.DesignScript.Geometry.Point)
degree = Input(degree: double)
python_script = Python(IN[0]=FreeCADObject, IN[1]=vector, IN[2]=point, IN[3]=degree)  # CPython3
# ---------- python_script.python (10 lines) ----------
import FreeCAD

obj = IN[0]
vec = IN[1]
pt = IN[2]
deg = IN[3]

obj.Placement.rotate((pt.X,pt.Y,pt.Z), FreeCAD.Vector(vec.X, vec.Y, vec.Z), deg)

OUT = obj
# ----------------------------------------
FreeCADObject_2 = Output(python_script)  # "FreeCADObject"
