# Dynamo custom node Object.Set.SetPropertyByName.dyf "SetPropertyByName" (Dynamo 2.9.0.2476)
# category: DynFreeCAD.Object.Set
# Set a property of a FreeCAD object by name

FreeCADObject = Input(FreeCADObject: System.Object)
propertyName = Input(propertyName: string)
propertyValue = Input(propertyValue: string)
python_script = Python(IN[0]=FreeCADObject, IN[1]=propertyName, IN[2]=propertyValue)  # CPython3
# ---------- python_script.python (9 lines) ----------
import FreeCAD

obj = IN[0]
propname = IN[1]
value = IN[2]

setattr(obj,propname,value)

OUT = obj
# ----------------------------------------
FreeCADObject_2 = Output(python_script)  # "FreeCADObject: System.Object"
