# Dynamo custom node OpenDocument.dyf (Dynamo 2.8.0.2471)
# category: DynFreeCAD.Document
# Open a document in FreeCAD

FreeCADModule = Input(FreeCADModule: var[]..[])
filePath = Input(filePath: string)
python_script = Python(IN[0]=FreeCADModule, IN[1]=filePath)  # CPython3
# ---------- python_script.python (7 lines) ----------
FreeCAD = IN[0]
docPath = IN[1]

ad = FreeCAD.openDocument(docPath)

    
OUT = [ad, FreeCAD]
# ----------------------------------------
code_block = CodeBlock(a=python_script) { a[0]; a[1]; }
FreeCADDocument = Output(code_block.out0)
FreeCADModule_2 = Output(code_block.out1)  # "FreeCADModule"
