# Dynamo custom node Part.Create.VertexByCoordinates.dyf "VertexByCoordinates" (Dynamo 2.9.0.2536)
# category: DynFreeCAD.Part.Create
# Create a FreeCAD Part primitive Vertex By coordinates

FreeCADDocument = Input(FreeCADDocument: System.Object)
name = Input(name: string = "")
x = Input(x: double)
y = Input(y: double)
z = Input(z: double)
python_script = Python(IN[0]=FreeCADDocument, IN[1]=name, IN[2]=x, IN[3]=y, IN[4]=z)  # CPython3
# ---------- python_script.python (16 lines) ----------
import FreeCAD
import Part

doc = IN[0]
name = IN[1]
x = IN[2]
y = IN[3]
z = IN[4]

vertex = doc.addObject("Part::Vertex",name)

vertex.X = x
vertex.Y = y
vertex.Z = z

OUT = vertex
# ----------------------------------------
FreeCADPartVertex = Output(python_script)  # "FreeCADPartVertex: System.Object"
