# Dynamo custom node Part.Create.VertexFromPoint.dyf "VertexFromPoint" (Dynamo 2.9.0.2536)
# category: DynFreeCAD.Part.Create
# Create a FreeCAD Part vertex from a Dynamo point. Supports multiple points as input

FreeCADDocument = Input(FreeCADDocument: System.Object)
point = Input(point: var)
python_script = Python(IN[0]=FreeCADDocument, IN[1]=point)  # CPython3
# ---------- python_script.python (14 lines) ----------
import FreeCAD
import Part

doc = IN[0]
dp = IN[1]

output = []

vertex = doc.addObject("Part::Vertex","")
vertex.X = dp.X
vertex.Y = dp.Y
vertex.Z = dp.Z

OUT = vertex
# ----------------------------------------
FreeCADPartVertex = Output(python_script)
