# Dynamo custom node WIP.InitializeWithGui.dyf "InitializeWithGui" (Dynamo 2.9.0.2476)
# category: DynFreeCAD.WIP
# ⚠ WIP! NOT WORKING YET! ⚠
# Start FreeCAD with Gui

FreeCADbinPath = Input(FreeCADbinPath: string)
pythonSitePackagesPath = Input(pythonSitePackagesPath: string)
python_script = Python(IN[0]=FreeCADbinPath, IN[1]=pythonSitePackagesPath)  # CPython3
# ---------- python_script.python (24 lines) ----------
freecad_bin_path = IN[0]
python_sitepackages_path = IN[1]

import sys

sys.path.append(python_sitepackages_path)
sys.path.append(freecad_bin_path)

from PySide2.QtWidgets import QApplication

import FreeCAD
import FreeCADGui

app = QApplication(sys.argv)

output = []

fc_version = FreeCAD.Version()
sys_path = sys.path

for outer in [fc_version, sys_path, FreeCAD, app]:
    output.append(outer)    

OUT = output
# ----------------------------------------
code_block = CodeBlock(a=python_script) { a[0]; a[1]; a[2]; a[3]; }
FreeCADversion = Output(code_block.out0)
uniqueItems = List.UniqueItems(list=code_block.out1)
sysPaths = Output(uniqueItems)
FreeCADModule = Output(code_block.out2)
QtApp = Output(code_block.out3)
