# Dynamo graph ApiLoader.dyn (Dynamo 2.9.0.2536)

directory_path = Directory("E:\_PortableApps\FreeCAD\FreeCAD-conda-PY3.8-site_packages1\bin")
python_script = Python(IN[0]=directory_path)  # CPython3
# ---------- python_script.python (39 lines) ----------
import sys
freecad_bin_path=IN[0]
sys.path.append(freecad_bin_path)

import FreeCAD

# libs:
import area
import DraftUtils
import Drawing
import Fem
import flatmesh
import Image
import Import
import Inspection
import Measure
import Mesh
import MeshPart
import Part
import Path
import PathSimulator
import Points
import Raytracing
import ReverseEngineering
import Robot
import Sketcher
import Surface

#mods:
#import Arch
#import Draft
import Material
import OpenSCAD
import Part
import Show
import Spreadsheet
import TechDraw
import Test
import Tux
# ----------------------------------------
