# Dynamo graph ApiLoaderArch.dyn (Dynamo 2.10.0.3071)

directory_path = Directory("E:\FreeCAD-conda-PY3.8-site_packages1\bin")
python_script = Python(IN[0]=directory_path)  # CPython3
# ---------- python_script.python (51 lines) ----------
import sys
freecad_bin_path=IN[0]
sys.path.append(freecad_bin_path)

try:
    errorReport = None
    
    import FreeCAD
    
    # libs:
    import area
    import DraftUtils
    import Drawing
    import Fem
    import flatmesh
    import Image
    import Import
    import Inspection
    import Measure
    import Mesh
    import MeshPart
    import Part
    import Path
    import PathSimulator
    import Points
    import Raytracing
    import ReverseEngineering
    import Robot
    import Sketcher
    import Surface
    
    #mods:
    import Arch
    import Draft
    import Material
    import OpenSCAD
    import Part
    import Show
    import Spreadsheet
    import TechDraw
    import Test
    import Tux
    
except:
    import traceback
    errorReport = traceback.format_exc()
    
if errorReport == None:
    OUT = ["FreeCAD API with Arch and Draft WBs successfully loaded", "You can now close this graph", FreeCAD.Version()]
else:
    OUT = errorReport
# ----------------------------------------
watch = Watch(python_script)
