# Dynamo graph ApiTester.dyn (Dynamo 2.8.0.2471)

directory_path = Directory("E:\FreeCAD-conda-PY3.8-site_packages1\bin")
python_script = Python(IN[0]=directory_path)  # CPython3
# ---------- python_script.python (7 lines) ----------
import sys
freecad_bin_path=IN[0]
sys.path.append(freecad_bin_path)

import FreeCAD

OUT = True
# ----------------------------------------
python_script_2 = Python(IN[0]=python_script)  # CPython3
# ---------- python_script_2.python (4 lines) ----------
import FreeCAD
import Mesh

OUT = ["FreeCAD API is loaded", dir(Mesh)]
# ----------------------------------------
watch = Watch(python_script_2)
