# Dynamo graph ApiLoaderGui.dyn (Dynamo 2.10.0.3071)

directory_path = Directory("E:\FreeCAD-conda-PY3.8-site_packages1\bin")
# note: This graph is not working yet!!!
# Do not use!!!
python_script = Python(IN[0]=directory_path)  # CPython3
# ---------- python_script.python (36 lines) ----------
import sys
freecad_bin_path = IN[0]
sys.path.append(freecad_bin_path)

try:
    errorReport = None


    from PySide2.QtWidgets import QApplication

    import FreeCAD
    import FreeCADGui

    if not QApplication.instance():
        app = QApplication(sys.argv)
    else:
        app = QApplication.instance()
    
    FreeCADGui.showMainWindow()

except:
    import traceback
    errorReport = traceback.format_exc()

if errorReport == None:
    output = []

    fc_version = FreeCAD.Version()
    sys_path = sys.path

    for outer in [fc_version, sys_path, FreeCAD, app]:
        output.append(outer)    

    OUT = output
else:
    OUT = errorReport
# ----------------------------------------
