# Dynamo graph ImportMesh.dyn (Dynamo 2.9.0.2591)

# group: New FreeCAD document
directory_path = Directory("E:\FreeCAD-conda-PY3.8-site_packages1\bin")
newDocument = Custom[NewDocument](FreeCADBinPath=directory_path)  # Create new document in FreeCAD

# group: Import a mesh to FreeCAD
file_path = Filename("E:\minicooper.obj")
insert = Custom[Insert](FreeCADDocument=newDocument.FreeCADDocument, importPath=file_path)  # Import a Mesh to a FreeCAD document

# group: List all objects except the group
listAllObjects = Custom[ListAllObjects](FreeCADDocument=insert)  # List all objects from a FreeCAD document
code_block = CodeBlock { "Group"; }
startsWith = String.StartsWith(str=listAllObjects.names, searchFor=code_block)
filterByBoolMask = List.FilterByBoolMask(list=listAllObjects.FreeCADObjects, mask=startsWith)

# group: Create and label a group
create = Custom[Create](FreeCADDocument=insert)  # Create a new empty FreeCAD Group
code_block_2 = CodeBlock { "Label"; "Imported"; }
setPropertyByName = Custom[SetPropertyByName](FreeCADObject=create.FreeCADGroup, propertyName=code_block_2.out0, propertyValue=code_block_2.out1)  # Set a property of a FreeCAD object by name

# group: Add objects to group
addToGroup = Custom[AddToGroup](FreeCADGroup=setPropertyByName)  # Add a FreeCAD object to a Group; unwired: FreeCADObject
map = List.Map(list=filterByBoolMask.out, f_x=addToGroup)

# group: Save FreeCAD document
file_path_2 = Filename("E:\Import.FCStd")
code_block_3 = CodeBlock(a=map) { a[0]; }
document = Custom[Document](FreeCADObject=code_block_3)  # Get the FreeCAD document of an object
saveAs = Custom[SaveAs](path=file_path_2, FreeCADDocument=document)  # Save FreeCAD document to a path
