# Dynamo graph ManageDocuments.dyn (Dynamo 2.8.0.2471)

# group: Initialize FreeCAD, open or create new document
directory_path = Directory("E:\_PortableApps\FreeCAD\FreeCAD-conda-PY3.8\bin")
initialize = Custom[Initialize](FreeCADBinPath=directory_path)  # Initialize FreeCAD api and FreeCAD version info
newDocument = Custom[NewDocument](FreeCADModule=initialize.FreeCADModule)  # Create new document in FreeCAD
file_path = Filename("E:\Nextcloud\BIM-CAFM-CAD\freecad\Part Test.FCStd")
openDocument = Custom[OpenDocument](filePath=file_path, FreeCADModule=initialize.FreeCADModule)  # Open a document in FreeCAD

# group: Change this to reload the graph in automatic mode
boolean = BoolSelector(true)

# group: List Documents
listDocuments = Custom[ListDocuments](reload=boolean, FreeCADModule=openDocument.FreeCADModule)  # List all open FreeCAD documents
activeDocument = Custom[ActiveDocument](reload=boolean, FreeCADModule=openDocument.FreeCADModule)  # Get active FreeCAD document

# group: Select an opened document
keys = DesignScript.Builtin.Dictionary.Keys(dictionary=listDocuments)
code_block = CodeBlock()
# ---------- code_block.designscript (2 lines) ----------
// Change this value to select the active document
1;
# ----------------------------------------
getItemAtIndex = List.GetItemAtIndex(list=keys, index=code_block)
valueAtKey = DesignScript.Builtin.Dictionary.ValueAtKey(dictionary=listDocuments, key=getItemAtIndex)

setActiveDocument = Custom[SetActiveDocument](FreeCADDocument=valueAtKey)  # Set active FreeCAD document

# group: Save document to a new path
file_path_2 = Filename("C:\Users\gyetpet\Desktop\test.FCStd")
saveAs = Custom[SaveAs](path=file_path_2, FreeCADDocument=activeDocument)  # Save FreeCAD document to a path

# group: Save document to the same path
fileName = Custom[FileName](FreeCADDocument=activeDocument)  # Full path including filename of a FreeCAD document
saveAs_2 = Custom[SaveAs](path=fileName, FreeCADDocument=activeDocument)

closeDocument = Custom[CloseDocument](FreeCADDocument=valueAtKey)  # Close an open FreeCAD document

# group: The name of the document
name = Custom[Name](FreeCADDocument=activeDocument)  # Returns the name of a FreeCAD document

# group: Close all open documents
boolean_2 = BoolSelector(true)
closeAllDocuments = Custom[CloseAllDocuments](run=boolean_2)  # Close all open FreeCAD documents
