# Dynamo graph MeshFromMeshToolkit.dyn (Dynamo 2.9.0.2591)
# packages: MeshToolkit 3.0.0

# group: New FreeCAD document
directory_path = Directory("E:\FreeCAD-conda-PY3.8-site_packages1\bin")
newDocument = Custom[NewDocument](FreeCADBinPath=directory_path)  # Create new document in FreeCAD

# group: Generate random points
code_block = CodeBlock { 0..9; }
byCoordinates = Point.ByCoordinates(x=code_block, y=code_block, lacing=CrossProduct)
count = List.Count(list=code_block)
code_block_2 = CodeBlock { 2; }
pow = Math.Pow(number=count, power=code_block_2)
randomList = Math.RandomList(amount=pow)
translate = Geometry.Translate(geometry=byCoordinates@L1, zTranslation=randomList@L1, lacing=Shortest)
sublists = List.Sublists(list=translate, ranges=code_block, offset=count)

# group: Dynamo Nurbs surface
byPoints = NurbsSurface.ByPoints(points=sublists)

# group: Generate MeshToolkit Mesh
code_block_3 = CodeBlock { 15; }
byGeometry = Autodesk.Dynamo.MeshToolkit.Mesh.ByGeometry(inputGeometry=byPoints, maxGridLines=code_block_3)

# group: Find Points
triangles = Autodesk.Dynamo.MeshToolkit.Mesh.Triangles(mesh=byGeometry)
perimeterCurves = Surface.PerimeterCurves(surface=triangles)
code_block_4 = CodeBlock(a=perimeterCurves) { a.StartPoint; }

# group: Create FreeCAD Mesh
meshFromPoints = Custom[MeshFromPoints](FreeCADDocument=newDocument.FreeCADDocument, points=code_block_4)  # Create a FreeCAD Mesh from a list of list of 3 Dynamo points. See example file and wiki for more info!

# group: Create Part from Mesh
document = Custom[Document](FreeCADObject=meshFromPoints)  # Get the FreeCAD document of an object
shapeFromMesh = Custom[ShapeFromMesh](FreeCADDocument=document, FreeCADMeshObject=meshFromPoints)  # Create a FreeCAD Part from a FreeCAD Mesh

# group: Save FreeCAD Document
file_path = Filename("E:\MeshToolkitMesh.FCStd")
document_2 = Custom[Document](FreeCADObject=shapeFromMesh)
recompute = Custom[Recompute](FreeCADDocument=document_2)  # Recompute a FreeCAD Document
saveAs = Custom[SaveAs](path=file_path, FreeCADDocument=recompute)  # Save FreeCAD document to a path
