# Dynamo graph MeshToolkitToArchProject.dyn (Dynamo 2.10.0.3071)
# packages: MeshToolkit 3.0.0

# group: New FreeCAD document
directory_path = Directory("E:\FreeCAD-conda-PY3.8-site_packages1\bin")
newDocument = Custom[NewDocument](FreeCADBinPath=directory_path)  # Create new document in FreeCAD

# group: Import mesh
file_path = Filename("C:\Users\gyetpet\Downloads\terobj\terobj.obj")
importFile = Autodesk.Dynamo.MeshToolkit.Mesh.ImportFile(fileName=file_path)

# group: Scale mesh
code_block = CodeBlock { 100; }
scale = Autodesk.Dynamo.MeshToolkit.Mesh.Scale(mesh=importFile, scaleFactor=code_block)

# group: Reduce mesh
code_block_2 = CodeBlock { 0.05; }
triangleCount = Autodesk.Dynamo.MeshToolkit.Mesh.TriangleCount(mesh=scale)
code_block_3 = CodeBlock(a=code_block_2, b=triangleCount) { a*b; }
reduce = Autodesk.Dynamo.MeshToolkit.Mesh.Reduce(mesh=scale, triangleCount=code_block_3)

# group: Move mesh above z=0 plane
vertices = Autodesk.Dynamo.MeshToolkit.Mesh.Vertices(mesh=reduce)
code_block_4 = CodeBlock(a=vertices) { a.Z; }
minimumItem = List.MinimumItem(list=code_block_4)
code_block_5 = CodeBlock(a=minimumItem) { a*-1; }
translate = Autodesk.Dynamo.MeshToolkit.Mesh.Translate(mesh=reduce, z=code_block_5)

# group: Create FreeCAD Part
vertices_2 = Autodesk.Dynamo.MeshToolkit.Mesh.Vertices(mesh=translate)
meshFromPoints = Custom[MeshFromPoints](FreeCADDocument=newDocument.FreeCADDocument, points=vertices_2)  # Create a FreeCAD Mesh from a list of list of 3 Dynamo points. See example file and wiki for more info!
shapeFromMesh = Custom[ShapeFromMesh](FreeCADDocument=newDocument.FreeCADDocument, FreeCADMeshObject=meshFromPoints)  # Create a FreeCAD Part from a FreeCAD Mesh

makeSite = Custom[MakeSite](FreeCADDocument=newDocument.FreeCADDocument, FreeCADTerrain=shapeFromMesh)  # Create a FreeCAD Arch Site object
makeProject = Custom[MakeProject](FreeCADDocument=makeSite.FreeCADDocument, FreeCADSite=makeSite.FreeCADSite)  # Create a FreeCAD Arch Project entity.
file_path_2 = Filename("E:\ArchProjectExample1.FCStd")
saveAs = Custom[SaveAs](path=file_path_2)  # Save FreeCAD document to a path; unwired: FreeCADDocument
