# Dynamo graph QueryData.dyn (Dynamo 2.9.0.2476)

file_path = Filename("E:\Nextcloud\BIM-CAFM-CAD\freecad\Part Test_2.FCStd")
directory_path = Directory("E:\_PortableApps\FreeCAD\FreeCAD-conda-PY3.8-site_packages1\bin")
openDocument = Custom[OpenDocument](filePath=file_path, FreeCADBinPath=directory_path)  # Open a document in FreeCAD
listAllObjects = Custom[ListAllObjects](FreeCADDocument=openDocument.FreeCADDocument)  # List all objects from a FreeCAD document
findAllObjects = Custom[FindAllObjects](FreeCADDocument=openDocument.FreeCADDocument)  # find FreeCAD objects in a document by specified type, name or label. All parameters are optional.
create = Custom[Create](FreeCADDocument=openDocument.FreeCADDocument)  # Create a new empty FreeCAD Group
code_block = CodeBlock { "Group"; }
getObjectByName = Custom[GetObjectByName](FreeCADDocument=openDocument.FreeCADDocument, objectName=code_block)  # Get object in a FreeCAD document by name
code_block_2 = CodeBlock { "Box"; }
getObjectByName_2 = Custom[GetObjectByName](FreeCADDocument=openDocument.FreeCADDocument, objectName=code_block_2)
addToGroup = Custom[AddToGroup](FreeCADGroup=getObjectByName, FreeCADObject=getObjectByName_2)  # Add a FreeCAD object to a Group
objects = Custom[Objects](FreeCADGroup=getObjectByName)  # List objects in a FreeCAD group
ID = Custom[ID](FreeCADObject=objects)  # Get the ID of a FreeCAD object
label = Custom[Label](FreeCADObject=objects)  # The label of a FreeCAD object
name = Custom[Name](FreeCADObject=objects)  # Name of a FreeCAD object
properties = Custom[Properties](FreeCADObject=objects)  # Properties of a FreeCAD object
code_block_3 = CodeBlock { "Label2"; }
code_block_4 = CodeBlock { "This is the label 2 value"; }
setPropertyByName = Custom[SetPropertyByName](FreeCADObject=objects, propertyName=code_block_3, propertyValue=code_block_4)  # Set a property of a FreeCAD object by name
