# Dynamo graph UseTheApi.dyn (Dynamo 2.9.0.2476)

file_path = Filename("E:\Dynamoline.FCStd")
directory_path = Directory("E:\_PortableApps\FreeCAD\FreeCAD-conda-PY3.8-site_packages1\bin")
newDocument = Custom[NewDocument](FreeCADBinPath=directory_path)  # Create new document in FreeCAD
byCoordinates = Point.ByCoordinates()
code_block = CodeBlock { 10; }
byCoordinates_2 = Point.ByCoordinates(x=code_block, y=code_block)
byStartPointEndPoint = Line.ByStartPointEndPoint(startPoint=byCoordinates, endPoint=byCoordinates_2)
python_script = Python(IN[0]=newDocument.FreeCADDocument, IN[1]=byStartPointEndPoint)  # CPython3
# ---------- python_script.python (13 lines) ----------
import FreeCAD
import Part

doc = IN[0]
line = IN[1]

l=Part.LineSegment()
l.StartPoint=(line.StartPoint.X,line.StartPoint.Y,0.0)
l.EndPoint=(line.EndPoint.X,line.EndPoint.Y,0.0)

doc.addObject("Part::Feature","Line").Shape=l.toShape()

OUT = doc
# ----------------------------------------
saveAs = Custom[SaveAs](path=file_path, FreeCADDocument=python_script)  # Save FreeCAD document to a path
