# Dynamo graph VertexFromPoint.dyn (Dynamo 2.9.0.2591)

# group: New FreeCAD document
directory_path = Directory("E:\FreeCAD-conda-PY3.8-site_packages1\bin")
newDocument = Custom[NewDocument](FreeCADBinPath=directory_path)  # Create new document in FreeCAD

# group: Create Dynamo points
code_block = CodeBlock { 0..19; }
list_create = List.Create(item0=code_block)
mul = code_block * code_block  # lacing=CrossProduct
count = List.Count(list=mul)
cycle = List.Cycle(list=list_create, amount=count)
code_block_2 = CodeBlock(a=mul) { a/50; }
byCoordinates = Point.ByCoordinates(x=cycle, z=code_block_2)  # unwired: y
map = List.Map(list=list_create, f_x=byCoordinates)
flatten = List.Flatten(list=map)

# group: Create FreeCADPartVertex from Dynamo Points
vertexFromPoint = Custom[VertexFromPoint](FreeCADDocument=newDocument.FreeCADDocument, point=flatten)  # Create a FreeCAD Part vertex from a Dynamo point. Supports multiple points as input

# group: Save FreeCAD Document
file_path = Filename("E:\Vertices.FCStd")
code_block_3 = CodeBlock(a=vertexFromPoint) { a[0]; }
document = Custom[Document](FreeCADObject=code_block_3)  # Get the FreeCAD document of an object
saveAs = Custom[SaveAs](path=file_path, FreeCADDocument=document)  # Save FreeCAD document to a path
