# Dynamo custom node Initialize.dyf (Dynamo 2.7.0.9206)
# category: DynFreeCAD.App
# Initialize FreeCAD api and FreeCAD version info

FreeCADbinPath = Input(FreeCADbinPath: string)
python_script = Python(IN[0]=FreeCADbinPath)  # CPython3
# ---------- python_script.python (12 lines) ----------
import clr

import sys

freecad_bin_path=IN[0]
sys.path.insert(0,freecad_bin_path)
import FreeCAD

fc_version = FreeCAD.Version()


OUT = fc_version
# ----------------------------------------
FreeCADversion = Output(python_script)
