# Dynamo custom node ListDocuments.dyf (Dynamo 2.7.0.9206)
# category: DynFreeCAD.Document
# List all open FreeCAD documents

Run = Input(Run: bool = true)
python_script = Python(IN[0]=Run)  # CPython3
# ---------- python_script.python (12 lines) ----------
# import
import clr
import FreeCAD

list_docs_dict = FreeCAD.listDocuments()
list_docs = []


for key in list_docs_dict:
	list_docs.append(key)

OUT = list_docs
# ----------------------------------------
listDocumentsName = Output(python_script)
