# Dynamo custom node Name.dyf (Dynamo 2.8.0.2327)
# category: DynFreeCAD.Document
# Returns the name of a FreeCAD document

FreeCADDocument = Input(FreeCADDocument: System.Object)
python_script = Python(IN[0]=FreeCADDocument)  # CPython3
# ---------- python_script.python (5 lines) ----------
import FreeCAD

doc = IN[0]

OUT= doc.Name
# ----------------------------------------
string = Output(python_script)
