# Dynamo custom node NewDocument.dyf (Dynamo 2.7.0.9206)
# category: DynFreeCAD.Document
# Create new document in FreeCAD

Name = Input(Name: string = None)
Run = Input(Run: bool = true)
python_script = Python(IN[0]=Name, IN[1]=Run)  # CPython3
# ---------- python_script.python (12 lines) ----------
# import
import clr
import FreeCAD

docName = IN[0]

if docName==None:
	doc = FreeCAD.newDocument()
else:
	doc = FreeCAD.newDocument(docName)

OUT = doc.Name
# ----------------------------------------
newDocumentName = Output(python_script)
