# Dynamo custom node OpenDocument.dyf (Dynamo 2.7.0.9206)
# category: DynFreeCAD.Document
# Open a document in FreeCAD

Path = Input(Path: string)
python_script = Python(IN[0]=Path)  # CPython3
# ---------- python_script.python (9 lines) ----------
# import
import clr
import FreeCAD

docPath = IN[0]

ad = FreeCAD.openDocument(docPath).Name

OUT = ad
# ----------------------------------------
activeDocumentName = Output(python_script)
