# Dynamo custom node SaveAs.dyf (Dynamo 2.8.0.2327)
# category: DynFreeCAD.Document
# Save FreeCAD document to a path

Path = Input(Path: string)
FreeCADDocument = Input(FreeCADDocument: System.Object = None)
python_script = Python(IN[0]=Path, IN[1]=FreeCADDocument)  # CPython3
# ---------- python_script.python (15 lines) ----------
import FreeCAD

docPath = IN[0]
doc = IN[1]

if doc==None:
	docSave = FreeCAD.ActiveDocument
else:
	docSave = doc


docSave.saveAs(docPath)


OUT = docSave
# ----------------------------------------
FreeCADDocument_2 = Output(python_script)  # "FreeCADDocument"
