# Dynamo custom node SetActiveDocument.dyf (Dynamo 2.8.0.2327)
# category: DynFreeCAD.Document
# Set active FreeCAD document

FreeCADDocument = Input(FreeCADDocument: System.Object)
python_script = Python(IN[0]=FreeCADDocument)  # CPython3
# ---------- python_script.python (11 lines) ----------
import FreeCAD

doc = IN[0]

FreeCAD.setActiveDocument(doc.Name)


ad = FreeCAD.ActiveDocument


OUT = ad
# ----------------------------------------
FreeCADDocument_2 = Output(python_script)  # "FreeCADDocument"
